# Grasshopper definition PlanarMeshExample.ghx (Grasshopper 0.9.75)
# plug-ins: PlanarMesh

mesh = Mesh(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)
ll = Lloyds(Mesh=mesh, Metric=Slider(1, range=0..1), NumberOfFacets=Slider(30, range=0..100))
pm = PlanariseMesh(Mesh=ll)  # -> Proxies, MeshAsCurves, Normals, Centres
boundary = BoundarySurfaces(Edges=graft(pm.MeshAsCurves))
preview = CustomPreview(
    Geometry=boundary,
    Shader={ambient=RGB(0, 0, 0), diffuse=RGB(255, 105, 180), emission=RGB(76, 32, 54), shine=0.5, specular=RGB(255, 255, 255), transparency=0})
