# Grasshopper definition PlanarMeshWithStarlingExample.ghx (Grasshopper 0.9.75)
# plug-ins: PlanarMesh, Starling

mesh = Mesh(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)
pm = PlanariseMesh(Mesh=mesh, Metric=1, NumberOfPanels=Slider(29, range=0..100), Run=Toggle(True))  # -> Output, Proxies, MeshAsCurves, HLwingMesh, Normals, Centres, VoronoiOnMesh
crv = Curve(pm.MeshAsCurves)
pmcomp = PmDecompose(Polylines=crv)  # -> Vertices, Faces
pmdual = PmDual(Polylines=crv, Type=0)
boundary = BoundarySurfaces(Edges=pmdual)
preview = CustomPreview(
    Geometry=boundary,
    Shader={ambient=RGB(0, 0, 0), diffuse=RGB(255, 105, 180), emission=RGB(76, 32, 54), shine=0.5, specular=RGB(255, 255, 255), transparency=0})
