# Grasshopper definition PlanarMeshWithWbExample.ghx (Grasshopper 0.9.75)
# plug-ins: PlanarMesh, Weaverbird

wbicosahedron = WeaverbirdsMeshMeshIcosahedron(Plane=PlaneXY(0, 0, 0), Radius=10)
wbloop = WeaverbirdsLoopSubdivision(MeshCurves=wbicosahedron, Level=1, SmoothNakedEdges=1)
wbdual = WeaverbirdsDualGraph(MeshCurves=wbloop, DualMode=0)
pm = PlanariseMesh(Mesh=wbdual)  # -> Proxies, MeshAsCurves, Normals, Centres

# ---- group: Are all curves planar?
allplanar = AllPlanar(crv=pm.MeshAsCurves)
panel = Panel(allplanar)

# ----
boundary = BoundarySurfaces(Edges=graft(pm.MeshAsCurves))
preview = CustomPreview(
    Geometry=boundary,
    Shader={ambient=RGB(0, 0, 0), diffuse=RGB(255, 105, 180), emission=RGB(76, 32, 54), shine=0.5, specular=RGB(255, 255, 255), transparency=0})

# ==== cluster AllPlanar: Returns true if all curves are planar
crv = ClusterInput()
crv_2 = Curve(crv)
planar = Planar(Curve=crv_2)  # -> Planar, Plane, Deviation
lng = ListLength(List=crv_2)
lng_2 = ListLength(List=planar.Planar)
equals = Equality(FirstNumber=lng_2, SecondNumber=lng)  # -> Equality, Inequality
equality = ClusterOutput(equals.Equality)
